# Grasshopper definition gh-ground-truth.ghx (Grasshopper 1.0.7)

python = GhPythonScript(activate=Toggle(False), start_proxy=Toggle(False))  # -> out, a; inputs activate: Boolean, start_proxy: Boolean
# ---------- python: Python ----------
from compas_ghpython import unload_modules
unload_modules('groundtruth')
from compas.rpc import Proxy

interface = None

if activate:
    if start_proxy:
        interface = Proxy('groundtruth.interactive.interface')
    else:
        Proxy.stop_server(interface)
        
        
if interface:
    interface.get_height_grid()
# ---------- end python ----------
